# Grasshopper definition xauat.gh (Grasshopper 1.0.5)
# plug-ins: Glasses

gg = GHGlasses()

# ---- group: File Path 文件路径
file_path = FilePath("D:\Desktop\PYTHON\jianda\OSM_sqlit.db")

# ---- group: SQL read 自动翻译失败
sql_read = SQLRead(database_sql=file_path, table="way")  # -> out, output
#   port database_sql: SQL database file path 译:自动翻译失败
#   port table: Specify a table 译:自动翻译失败
#   port output: table content 译:自动翻译失败
# ---------- sql_read: Python ----------
"""Read SQL table.
    Inputs:
        database_sql: SQL database file path
        table: Specify a table
    Output:
        output: table content"""

__author__ = "Richie Bao-Chicago.IIT(driverless city project)"
__version__ = "2020.11.30"

ghenv.Component.Name = 'SQL read'
ghenv.Component.NickName = 'SQL read'
ghenv.Component.Message = '0.0.1'
ghenv.Component.Category = 'driverless-city'
ghenv.Component.SubCategory = '0 :: SQL'
ghenv.Component.AdditionalHelpFromDocStrings = '5'

import rhinoscriptsyntax as rs
import sqlite3
import ghpythonlib.treehelpers as th
import Rhino

conn=sqlite3.connect(database_sql)
with conn:
    cur = conn.cursor()
    cur.execute("SELECT * FROM %s"%table)
    rows = cur.fetchall()


layerTree = th.list_to_tree(rows, source=[0,])
output=layerTree
# ---------- end sql_read ----------

sql_read_2 = SQLRead(database_sql=file_path, table="node")  # -> out, output; same code as sql_read

sql_read_3 = SQLRead(database_sql=file_path)  # -> out, output; same code as sql_read

# ---- group: way to points 自动翻译失败
way2pts = WayToPoints(sql_data=sql_read.output, field="tags")  # -> out, out_by_field, X, Y; inputs sql_data: tree
#   port sql_data: SQL data readed 译:翻译试用
#   port field: data field ready to handle 译:翻译试用
# ---------- way2pts: Python ----------
"""Read SQL table.
    Inputs:
        sql_data: SQL data readed
        field: data field ready to handle
    Output:
        out_by_field: export data by the field specified"""

__author__ = "Richie Bao-Chicago.IIT(driverless city project)"
__version__ = "2020.12.09"

ghenv.Component.Name = 'way to points'
ghenv.Component.NickName = 'way2pts'
ghenv.Component.Message = '0.0.1'
ghenv.Component.Category = 'driverless-city'
ghenv.Component.SubCategory = '0 :: SQL'
ghenv.Component.AdditionalHelpFromDocStrings = '5'

import rhinoscriptsyntax as rs
import sqlite3
import ghpythonlib.treehelpers as th
import Rhino

data=th.tree_to_list(sql_data)

if field=='geometry':   
    x=[[v[0] for v in eval(d[2])] for d in data]
    y=[[v[1] for v in eval(d[2])] for d in data]
    
    X=th.list_to_tree(x,source=[0,0])
    Y=th.list_to_tree(y,source=[0,0])
    
    
    
    
if field=='tags':
    tags=[d[11] for d in data]
    out_by_field=tags
# ---------- end way2pts ----------

# ---- group: coordinates string to points 自动翻译失败
coordi2pts = CoordinatesStringToPoints(sql_data=sql_read_2.output, field="tags")  # -> out, out_by_field; inputs sql_data: tree
#   port sql_data: SQL data readed 译:翻译试用
#   port field: data field ready to handle 译:翻译试用
# ---------- coordi2pts: Python ----------
"""Read SQL table.
    Inputs:
        sql_data: SQL data readed
        field: data field ready to handle
    Output:
        out_by_field: export data by the field specified"""

__author__ = "Richie Bao-Chicago.IIT(driverless city project)"
__version__ = "2020.12.09"

ghenv.Component.Name = 'coordinates string to points'
ghenv.Component.NickName = 'coordi2pts'
ghenv.Component.Message = '0.0.1'
ghenv.Component.Category = 'driverless-city'
ghenv.Component.SubCategory = '0 :: SQL'
ghenv.Component.AdditionalHelpFromDocStrings = '5'

import rhinoscriptsyntax as rs
import sqlite3
import ghpythonlib.treehelpers as th
import Rhino

data=th.tree_to_list(sql_data)

if field=='geometry':    
    x=[eval(d[2])[0] for d in data]
    y=[eval(d[2])[1] for d in data]
    
    out_by_field=th.list_to_tree([x,y],source=[0,0])
    
if field=='tags':
    tags=[d[11] for d in data]
    out_by_field=tags
# ---------- end coordi2pts ----------

coordi2pts_2 = CoordinatesStringToPoints(sql_data=sql_read_2.output, field="geometry")  # -> out, out_by_field; inputs sql_data: tree; same code as coordi2pts

# ---- group: way to points 自动翻译失败
way2pts_2 = WayToPoints(sql_data=sql_read.output, field="geometry")  # -> out, out_by_field, X, Y; inputs sql_data: tree; same code as way2pts

# ---- group: coordinates string to points 自动翻译失败
coordi2pts_3 = CoordinatesStringToPoints(sql_data=sql_read_2.output, field="tags")  # -> out, out_by_field; inputs sql_data: tree; same code as coordi2pts

# ---- group: tags group 翻译试用
tags2group = TagsGroup(tags=way2pts.out_by_field, tag_given="building")  # -> out, tags_bool; inputs tags: list
#   port tags: tags string 译:翻译试用
# ---------- tags2group: Python ----------
"""Processing the tags of OSM.
    Inputs:
        tags: tags string
        field: data field ready to handle
    Output:
        labels: all of the tags name
        tags_bool: 
            """

__author__ = "Richie Bao-Chicago.IIT(driverless city project)"
__version__ = "2020.12.09"

ghenv.Component.Name = 'tags group'
ghenv.Component.NickName = 'tags2group'
ghenv.Component.Message = '0.0.1'
ghenv.Component.Category = 'driverless-city'
ghenv.Component.SubCategory = '0 :: SQL'
ghenv.Component.AdditionalHelpFromDocStrings = '5'

import rhinoscriptsyntax as rs
import sqlite3
import ghpythonlib.treehelpers as th
import Rhino

tag_b=[]
if tag_given is not None:
    for row in tags:
        #print(eval(row).keys())
        if tag_given in eval(row).keys():
            tag_b.append(1)
        else:
            tag_b.append(0)


tags_bool=tag_b
# ---------- end tags2group ----------

# ---- group: Flip Matrix 转置矩阵
flip_matrix = FlipMatrix(Data=coordi2pts_2.out_by_field)

# ---- group: Match Text 匹配文本
match_text = MatchText(Text=coordi2pts.out_by_field, Pattern="{}", Case=True)

# ---- group: Multiplication 乘法
multiplication = Multiplication(A=flip_matrix, B=Slider(1.7e-05, range=0..0.001))

# ---- group: Construct Point 构造点
construct_point = ConstructPoint(XCoordinate=way2pts_2.X, YCoordinate=way2pts_2.Y, ZCoordinate=0)

# ---- group: points attribute 翻译试用
pts_attri = PointsAttribute()  # -> out, pts_attri; inputs points: list
#   port attribute: Configure points' attribute 译:翻译试用
# ---------- pts_attri: Python ----------
"""Provides a scripting component.
    Inputs:
        points: Specify some points with an attribute
        attribute: Configure points' attribute
    Output:
        pts_attri: points given with certian attribute"""

__author__ = "Richie Bao-Chicago.IIT(driverless city project)"
__version__ = "2020.11.30"

ghenv.Component.Name = 'points attribute'
ghenv.Component.NickName = 'pts attri'
ghenv.Component.Message = '0.0.1'
ghenv.Component.Category = 'driverless-city'
ghenv.Component.SubCategory = '1 :: SQL'
ghenv.Component.AdditionalHelpFromDocStrings = '5'

import rhinoscriptsyntax as rs
import ghpythonlib.treehelpers as th
pts_coordi=[[c for c in rs.PointCoordinates(pt)]+[attribute] for pt in points]
pts_attri=th.list_to_tree(pts_coordi, source=[0,])
# ---------- end pts_attri ----------

# ---- group: Gate Not 非门
gate_not = GateNot(A=match_text)

# ---- group: Numbers to Points 数字成点
numbers_to_points = NumbersToPoints(Numbers=flip_matrix, Mask=2)

# ---- group: Multiplication 乘法
multiplication_2 = Multiplication(B=Slider(10000, range=0..10000))

# ---- group: Point 点
point = Point(construct_point)

# ---- group: PolyLine 多段线
polyline = PolyLine(Vertices=construct_point, Closed=False)

# ---- group: Colour Swatch 颜色取样
colour_swatch = ColourSwatch(SwatchColor=RGB(25, 227, 203))

# ---- group: Cull Pattern 筛选模式
cull_pattern = CullPattern(List=flatten(numbers_to_points), CullPattern=gate_not)

cull_pattern_2 = CullPattern(List=flatten(polyline), CullPattern=flatten(tags2group.tags_bool))

# ----
panel = Panel(cull_pattern)

# ---- group: Colour Swatch 颜色取样
colour_swatch_2 = ColourSwatch(SwatchColor=RGB(48, 156, 86))

# ---- group: Construct Point 构造点
construct_point_2 = ConstructPoint(XCoordinate=0, YCoordinate=0, ZCoordinate=0)

# ---- group: Custom Preview 自定义预览
custom_preview = CustomPreview(Geometry=cull_pattern_2, Material=colour_swatch_2)

# ---- group: Closest Point 最近的点
closest_point = ClosestPoint(Point=construct_point_2, Cloud=flatten(numbers_to_points))  # -> ClosestPoint, CPIndex, Distance

# ---- group: Dot Display 点显示
dot_display = DotDisplay(Point=cull_pattern, Colour=colour_swatch, Size=Slider(1, range=0..1))

# ----
number_slider = Slider(4.0025, range=0..10)

# ---- group: List Item 列表项
list_item = ListItem(List=coordi2pts.out_by_field, Index=closest_point.CPIndex, Wrap=True)

list_item_2 = ListItem(List=flatten(numbers_to_points), Index=closest_point.CPIndex, Wrap=True)

# ---- group: Colour Swatch 颜色取样
colour_swatch_3 = ColourSwatch(SwatchColor=RGB(222, 154, 29))

# ---- group: Text Tag 3D 文字
text_tag_3d = TextTag3D(Location=list_item_2, Text=list_item, Size=number_slider, Colour=colour_swatch_3, Justification=7)

# ---- group: Dot Display 点显示
dot_display_2 = DotDisplay(Point=list_item_2, Colour=colour_swatch_3, Size=Slider(1.6756, range=0..10))

# ---- group: tags group 翻译试用
tags2group_2 = TagsGroup(tags=way2pts.out_by_field, tag_given="highway")  # -> out, tags_bool; inputs tags: list
#   port tags: tags string 译:翻译试用
# ---------- tags2group_2: Python ----------
"""Processing the tags of OSM.
    Inputs:
        tags: tags string
        field: data field ready to handle
    Output:
        labels: all of the tags name
        tags_bool: 
            """

__author__ = "Richie Bao-Chicago.IIT(driverless city project)"
__version__ = "2020.12.09"

ghenv.Component.Name = 'tags group'
ghenv.Component.NickName = 'tags2group'
ghenv.Component.Message = '0.0.1'
ghenv.Component.Category = 'driverless-city'
ghenv.Component.SubCategory = '0 :: SQL'
ghenv.Component.AdditionalHelpFromDocStrings = '5'

import rhinoscriptsyntax as rs
import sqlite3
import ghpythonlib.treehelpers as th
import Rhino

tag_b=[]
if tag_given is not None:
    for row in tags:
        #print(eval(row).keys())
        if tag_given in eval(row).keys():
            tag_b.append(1)
        else:
            tag_b.append(0)

tags_bool=tag_b
# ---------- end tags2group_2 ----------

tags2group_3 = TagsGroup(tags=way2pts.out_by_field, tag_given="sport")  # -> out, tags_bool; inputs tags: list; same code as tags2group_2

# ---- group: Construct Point 构造点
construct_point_3 = ConstructPoint(XCoordinate=0, YCoordinate=0, ZCoordinate=0)

# ---- group: closest objec indx 翻译试用
closest_obj_ikx = ClosestObjecIndx(objs=flatten(polyline), point=construct_point_3)  # -> out, closest_obj, obj_idx, closest_point; inputs objs: list
#   port objs: objects list 译:自动翻译失败
#   port closest_obj: the closest object 译:翻译试用
# ---------- closest_obj_ikx: Python ----------
"""find the nearest obj index.
    Inputs:
        objs: objects list
        point: a point used to find the nearest object
    Output:
        closest_obj: the closest object
        obj_idx: the closest object index
        closest_point:the nereast point projecting to the closest object
            """

__author__ = "Richie Bao-Chicago.IIT(driverless city project)"
__version__ = "2020.12.09"

ghenv.Component.Name = 'closest objec indx'
ghenv.Component.NickName = 'closest obj Ikx'
ghenv.Component.Message = '0.0.1'
ghenv.Component.Category = 'driverless-city'
ghenv.Component.SubCategory = '0 :: SQL'
ghenv.Component.AdditionalHelpFromDocStrings = '5'

import rhinoscriptsyntax as rs
import sqlite3
import ghpythonlib.treehelpers as th
import Rhino

results=rs.PointClosestObject(point,objs)
if results:
    obj=results[0]
    closest_point=results[1]

    idx=0
    for o in objs:
        if o==obj:
            obj_idx=idx
        idx+=1

closest_obj=obj
# ---------- end closest_obj_ikx ----------

# ---- group: tags group 翻译试用
tags2group_4 = TagsGroup(tags=way2pts.out_by_field, tag_given="amenity")  # -> out, tags_bool; inputs tags: list; same code as tags2group_2

# ---- group: List Item 列表项
list_item_3 = ListItem(List=way2pts.out_by_field, Index=closest_obj_ikx.obj_idx, Wrap=True)

# ---- group: Colour Swatch 颜色取样
colour_swatch_4 = ColourSwatch(SwatchColor=RGB(204, 39, 83))

# ---- group: Cull Pattern 筛选模式
cull_pattern_3 = CullPattern(List=flatten(polyline), CullPattern=flatten(tags2group_2.tags_bool))

# ---- group: Colour Swatch 颜色取样
colour_swatch_5 = ColourSwatch(SwatchColor=RGB(152, 48, 186))

# ---- group: Cull Pattern 筛选模式
cull_pattern_4 = CullPattern(List=flatten(polyline), CullPattern=flatten(tags2group_4.tags_bool))

# ---- group: Colour Swatch 颜色取样
colour_swatch_6 = ColourSwatch(SwatchColor=RGB(41, 143, 171))

# ---- group: Cull Pattern 筛选模式
cull_pattern_5 = CullPattern(List=flatten(polyline), CullPattern=flatten(tags2group_3.tags_bool))

# ---- group: Colour Swatch 颜色取样
colour_swatch_7 = ColourSwatch(SwatchColor=RGB(40, 35, 204))

# ---- group: Custom Preview 自定义预览
custom_preview_2 = CustomPreview(Geometry=closest_obj_ikx.closest_obj, Material=colour_swatch_4)

# ---- group: Text Tag 3D 文字
text_tag_3d_2 = TextTag3D(Location=construct_point_3, Text=list_item_3, Size=number_slider, Colour=colour_swatch_4, Justification=7)

# ---- group: Custom Preview 自定义预览
custom_preview_3 = CustomPreview(Geometry=cull_pattern_3, Material=colour_swatch_5)

custom_preview_4 = CustomPreview(Geometry=cull_pattern_4, Material=colour_swatch_6)

custom_preview_5 = CustomPreview(Geometry=cull_pattern_5, Material=colour_swatch_7)

# ----
panel_2 = Panel(cull_pattern_3)
